# Grasshopper definition builder_test.gh (Grasshopper 1.0.8)
# plug-ins: ComputeBuilder

change = Slider(7, range=0..20)
value_list = ValueList({"One": 1, "Two": 2, "Three": 2² - 1, "WhatsUp": 10, "Wuff": Null}, selected="Wuff")
num_nu = GetNumber(change, AtLeast=1, AtMost=1, Maximum=25, Minimum=5, TreeAccess=False)
im_text = GetString("fdfsdfsdfsdfsdfsdf", AtLeast=1, AtMost=1, TreeAccess=False)
valuelisterina = GetValueList(value_list, AtLeast=1, AtMost=1, Immediate=True, TreeAccess=False)
sphere = Sphere(Base=PlaneXY(0, 0, 0), Radius=num_nu)
multiplication = Multiplication(A=num_nu, B=Slider(2, range=0..10))
unit_x = UnitX(Factor=multiplication)
panel = Panel(im_text)
ui_builder = UIBuilder(
    Enable=Toggle(True),
    Schema="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",
    SessionId="dyLL5n-E",
    Values="{\"12e4b4b9-2767-426b-baa5-0a0e1bcd0a5b\":12}")  # -> SessionID, Info, Schema
number = Number(num_nu)
linear_array = LinearArray(Geometry=sphere, Direction=unit_x, Count="40")  # -> Geometry, Transform
panel_2 = Panel(ui_builder.Info)
schema = ContextPrint(Schema=ui_builder.Schema)
addition = Addition(A=number, B=Slider(100, range=0..1000))
texterop = ContextPrint(ThisIsTheMainPut=addition)
three_material = ThreeMaterial(Color=RGB(255, 255, 255), Metalness=0, Roughness=0.5, Opacity=1, Transparent=False)
display = Display(Geo=linear_array.Geometry, ThreeMaterial=three_material)
name_that_should_not_be_named = ContextBake(OutPutName=display)
