# Grasshopper definition builder_test.gh (Grasshopper 1.0.8)
# plug-ins: ComputeBuilder, Compuceraptor

num_nu = GetNumber(Slider(12, range=0..20), AtLeast=1, AtMost=1, Maximum=100, Minimum=10, TreeAccess=False)
get_string = GetString("fgdffgdfg", AtLeast=1, AtMost=1, TreeAccess=False)
sphere = Sphere(Base=PlaneXY(0, 0, 0), Radius=num_nu)
panel = Panel(num_nu)
panel_2 = Panel(get_string)
ui_builder = UIBuilder(Enable=Toggle(False), Refresh=Button(), Schema="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", SessionId="526696d1")  # -> SessionID, Info, Schema
number = Number(num_nu)
addition = Addition(A=number, B=Slider(100, range=0..1000))
display = Display(Geo=sphere)
number_output = ContextPrint(NumberOutput=addition)
context_bake = ContextBake(Content=display)
schema = ContextPrint(Schema=ui_builder.Schema)
